# Grasshopper definition shelf-solution.gh (Grasshopper 1.0.7)
# plug-ins: Triceratops, Anemone, Swiftlet

# Visualize Sky Matrix
# Annual Radiation
# Run Radiation Study
width = Panel("""600
1200
1800""")
height = Panel("""600
1200
1800""")
U = Panel("""2
3
4
5
6""")
V = Panel("""2
3
4
5
6""")
max_options = GhPythonScript(Width=width, Height=height, U=U, V=V)  # -> simplify(Result); inputs Width: list of Int32, Height: list of Int32, U: list of Int32, V: list of Int32
# ---------- max_options: Python ----------
__author__ = "Paul"
__version__ = "2024.10.21"

import rhinoscriptsyntax as rs
import ghpythonlib.treehelpers as th
from itertools import product

tree = []

items = [Width, Height, U, V]

for item in product(*items):
    tree.append(item)


Result = th.list_to_tree(tree, source=[0,0])
# ---------- end max_options ----------
tree_statistics = TreeStatistics(Tree=max_options)  # -> Paths, Length, Count
loop_start = LoopStart(Repeat=expr("x-1", tree_statistics.Count), Trigger=Button())  # -> port, Counter, Valid, Data, Width, Height, Data_2, Data_3, Data_4
tree_branch = TreeBranch(Tree=max_options, Path=loop_start.Counter, MaintainPaths=True)
panel = Panel(loop_start.Counter)
list_item = ListItem(List=tree_branch, Index=0, Wrap=False)  # -> Item, Item1, Item2, Item3
thickness = Slider(15, range=0..1000)
depth = Slider(200, range=0..1000)
generate_shelf = GenerateShelf(height=list_item.Item1, width=list_item.Item, U=list_item.Item2, V=list_item.Item3, thickness=thickness, depth=depth)  # -> valid_2, mesh_2
loop_end = LoopEnd(
    port=loop_start.port,
    Exit=False,
    Valid=generate_shelf.valid_2,
    Data=generate_shelf.mesh_2,
    Width=list_item.Item,
    Height=list_item.Item1,
    Data_2=list_item.Item2,
    Data_3=list_item.Item3,
    Data_4=loop_start.Counter,
    TimeOutVal=0,
    pausedState=False,
    state="Constant & Record")  # -> simplify(flatten(Valid)), simplify(flatten(Mesh)), simplify(flatten(Width)), simplify(flatten(Height)), simplify(flatten(U)), simplify(flatten(V)), simplify(flatten(ID))

cull_pattern = CullPattern(List=loop_end.Mesh, CullPattern=loop_end.Valid)  # -> graft(List)
cull_pattern_2 = CullPattern(List=loop_end.Width, CullPattern=loop_end.Valid)  # -> graft(List)
cull_pattern_3 = CullPattern(List=loop_end.Height, CullPattern=loop_end.Valid)  # -> graft(List)
cull_pattern_4 = CullPattern(List=loop_end.U, CullPattern=loop_end.Valid)  # -> graft(List)
cull_pattern_5 = CullPattern(List=loop_end.V, CullPattern=loop_end.Valid)  # -> graft(List)
cull_pattern_6 = CullPattern(List=loop_end.ID, CullPattern=loop_end.Valid)  # -> graft(List)

merge = Merge(
    Data1=simplify(cull_pattern_6),
    Data2=simplify(cull_pattern_2),
    Data3=simplify(cull_pattern_3),
    Data4=simplify(cull_pattern_4),
    Data5=simplify(cull_pattern_5))
clean_tree = CleanTree(RemoveNulls=True, RemoveInvalid=True, RemoveEmpty=True, Tree=merge)

tree_statistics_2 = TreeStatistics(Tree=cull_pattern)  # -> Paths, Length, Count
panel_2 = Panel("""id
width
height
u
v""")
duplicate_data = DuplicateData(Data=panel_2, Number=tree_statistics_2.Count, Order=True)
list_length = ListLength(List=panel_2)
partition_list = PartitionList(List=duplicate_data, Size=list_length)  # -> simplify(Chunks)
tree_statistics_3 = TreeStatistics(Tree=partition_list)  # -> Paths, Length, Count
cull_pattern_7 = CullPattern(List=tree_statistics_3.Paths, CullPattern=flatten(loop_end.Valid))
split_tree = SplitTree(Data=partition_list, Masks=flatten(cull_pattern_7))  # -> Positive, Negative

number_slider = Slider(100, range=0..100)
construct_point = ConstructPoint(XCoordinate=number_slider, YCoordinate=number_slider, ZCoordinate=number_slider)
point = Point(construct_point)
spotlight = SpotLight(
    Position=point,
    Color=RGB(255, 255, 255),
    Intensity=Slider(1, range=0..10),
    Angle=Slider(207, range=0..1000),
    Distance=0,
    Decay=Slider(0.1, range=0..1),
    CastShadow=True)  # -> Helper, Light

equality = Equality(FirstNumber=tree_statistics.Count, SecondNumber=expr("x+1", loop_start.Counter))  # -> Equality, Inequality

hex_to_color = HexToColor(Hex="e67e22")
colour = Colour(hex_to_color)

hempispherelight = HempisphereLight(Color=RGB(135, 206, 250), GroundColor=RGB(210, 180, 140), Intensity=Slider(1, range=0..10))

ambientlight = AmbientLight(Color=RGB(255, 255, 255), Intensity=Slider(1.02, range=0..10))

userdata = UserData(Keys=split_tree.Positive, Values=clean_tree)

fog = Fog(Color=ColourSwatch(SwatchColor=RGB(0, 0, 0)), Near=Slider(25, range=0..1000), Far="80000")

stream_filter = StreamFilter(Gate=equality.Equality, Stream1=cull_pattern)
stream_filter_2 = StreamFilter(Gate=equality.Equality, Stream1=userdata)

meshstandardmaterial = MeshStandardMaterial(Color=colour, Opacity=1, Roughness=1, Metalness=0.5, Emissive=RGB(0, 0, 0), EmissiveIntensity=1)

match_tree = MatchTree(Tree=stream_filter_2, Guide=stream_filter)
mesh = Mesh(Mesh=simplify(stream_filter), Name="shelf", Material=meshstandardmaterial, DecimalAccuracy=5, UserData=match_tree)  # -> simplify(flatten(Geometry))

relativepath = RelativePath()
text_split = TextSplit(Text=relativepath, Separators="/")
cull_index = CullIndex(List=text_split, Indices=-1, Wrap=True)
text_join = TextJoin(Text=cull_index, Join="/")
merge_2 = Merge(Data1=flatten(text_join), Data2=flatten("assets"))  # -> flatten(Result)
text_join_2 = TextJoin(Text=merge_2, Join="/")

merge_3 = Merge(Data1=mesh, Data2=hempispherelight, Data3=spotlight.Light, Data4=ambientlight)
compile_scene = CompileScene(Objects=flatten(merge_3), BackgroundColor=ColourSwatch(SwatchColor=RGB(48, 48, 48)), Fog=fog)
boolean = Boolean(equality.Equality)
serializeobject = SerializeObject(Object3d=compile_scene, Minify=False, Run=boolean)
write_text_file = WriteTextFile(Path=text_join_2, FileName="shelf.json", Data=serializeobject, Write=boolean)

# ==== cluster GenerateShelf
height = ClusterInput()
thickness = ClusterInput()
depth = ClusterInput()
height_2 = Number(height)
width = ClusterInput()
thickness_2 = Number(thickness)
depth_2 = Number(depth)
width_2 = Number(width)
construct_domain = ConstructDomain(DomainStart=expr("-x/2", depth_2), DomainEnd=expr("x/2", depth_2))
expression = Expression(x=width_2, y=thickness_2, Expression="y/x")
expression_2 = Expression(x=height_2, y=thickness_2, Expression="(x-y)/x")
U = ClusterInput()
V = ClusterInput()
number = Number(height_2)
U_2 = Integer(U)
construct_domain_2 = ConstructDomain(DomainStart=expr("-x/2", width_2), DomainEnd=expr("x/2", width_2))
V_2 = Integer(V)
construct_domain_3 = ConstructDomain(DomainStart=expression, DomainEnd=1)
construct_domain_4 = ConstructDomain(DomainStart=expr("-x/2", number), DomainEnd=expr("x/2", number))
construct_domain_5 = ConstructDomain(DomainStart=0, DomainEnd=expression_2)
range = Range(Domain=construct_domain_3, Steps=expr("x-1", U_2))
domain_box = DomainBox(Base=PlaneXY(0, 0, 0), X=construct_domain, Y=construct_domain_2, Z=construct_domain_4)
range_2 = Range(Domain=construct_domain_5, Steps=expr("x-1", V_2))
evaluate_box = EvaluateBox(Box=domain_box, UParameter=0.5, VParameter=0.5, WParameter=range_2)  # -> Plane, Point, Include
evaluate_box_2 = EvaluateBox(Box=domain_box, UParameter=0.5, VParameter=range, WParameter=0.5)  # -> Plane, Point, Include
deconstruct_plane = DeconstructPlane(Plane=evaluate_box_2.Plane)  # -> Origin, XAxis, YAxis, ZAxis
rectangle = Rectangle(Plane=evaluate_box.Plane, XSize=construct_domain, YSize=construct_domain_2, Radius=0)  # -> Rectangle, Length
unit_z = UnitZ(Factor=1)
construct_plane = ConstructPlane(Origin=deconstruct_plane.Origin, XAxis=Vector(1, 0, 0), YAxis=unit_z)
rectangle_2 = Rectangle(Plane=construct_plane, XSize=construct_domain, YSize=construct_domain_4, Radius=0)  # -> Rectangle, Length
box_rectangle = BoxRectangle(Rectangle=rectangle_2.Rectangle, Height=thickness_2)
box_rectangle_2 = BoxRectangle(Rectangle=rectangle.Rectangle, Height=thickness_2)
merge = Merge(Data1=box_rectangle, Data2=box_rectangle_2)  # -> flatten(Result)
brep_join = BrepJoin(Breps=merge)  # -> Breps, Closed
mesh_brep = MeshBrep(
    Brep=brep_join.Breps,
    Settings={GridMaxCount=0, GridMinCount=16, JaggedSeams=False, MaxEdgeLength=0, MinEdgeLength=0.0001, MinTolerance=0, Refine=True, RefineAngle=0, RelativeTolerance=0.65, SimplePlanes=True, Tolerance=0})
expression_3 = Expression(size=width_2, count=U_2, thickness=thickness_2, Expression="(size - thickness * count)/ (count - 1)")
expression_4 = Expression(size=height_2, count=V_2, thickness=thickness_2, Expression="(size - thickness * count)/ (count - 1)")
mesh_join = MeshJoin(Meshes=mesh_brep)
mesh = Mesh(mesh_join)
mesh_2 = ClusterOutput(mesh)
larger_than = LargerThan(FirstNumber=expression_3, SecondNumber="100")  # -> LargerThan, OrEqualTo
larger_than_2 = LargerThan(FirstNumber=expression_4, SecondNumber="100")  # -> LargerThan, OrEqualTo
gate_and = GateAnd(A=larger_than.OrEqualTo, B=larger_than_2.OrEqualTo)
valid = Boolean(gate_and)
valid_2 = ClusterOutput(valid)
